% Simulink data dictionary euler_nfo.sldd

ia = Simulink.Signal(StorageClass="ExportedGlobal", DataType="single")
ic = Simulink.Signal(StorageClass="ExportedGlobal", DataType="single")
ib = Simulink.Signal(StorageClass="ExportedGlobal", DataType="single")
ialpha = Simulink.Signal(StorageClass="ExportedGlobal", DataType="single")
ibeta = Simulink.Signal(StorageClass="ExportedGlobal", DataType="single")
id = Simulink.Signal(StorageClass="ExportedGlobal", DataType="single")
iq = Simulink.Signal(StorageClass="ExportedGlobal", DataType="single")
Sig = Simulink.Signal()
Udc = Simulink.Parameter(24, DataType="single")
Ts = Simulink.Parameter(0.0001, DataType="single")
L = Simulink.Parameter(0.00535, DataType="single")
Rs = Simulink.Parameter(6.97, DataType="single")
flux = Simulink.Parameter(0.016884, DataType="single")
Pn = Simulink.Parameter(4, DataType="single")
smo_we = Simulink.Signal(StorageClass="ExportedGlobal", DataType="single")
GainK = Simulink.Parameter(300, DataType="single")
GainM = Simulink.Parameter(18000, DataType="single")