% Simulink data dictionary NFO.sldd

Ts = 0.0001
TsModel = 2.5e-5
PMSM_B = 0.0004924
PMSM_J = 0.0027
PMSM_CCR_Counter = 4199
PMSM_Ld = 0.0001952
PMSM_Lq = 0.0001952
PMSM_Ls = 0.0001952
PMSM_Pn = 5
PMSM_flux = 0.011
J = Simulink.Parameter(0.00027, StorageClass="Struct", StructName="PMSM_Para")
B = Simulink.Parameter(1.0e-5, StorageClass="Struct", StructName="PMSM_Para")
Pn = Simulink.Parameter(5)
Real_Iq = Simulink.Signal(StorageClass="Struct", StructName="Obe_data")
Obe_theta = Simulink.Signal(StorageClass="Struct", StructName="Obe_data")
Obe_omega = Simulink.Signal(StorageClass="Struct", StructName="Obe_data")
Rs = Simulink.Parameter(0.1763, StorageClass="Struct", StructName="PMSM_Para")
flux = Simulink.Parameter(0.011, StorageClass="Struct", StructName="PMSM_Para")
PMSM_Rs = 0.1763
Ld = Simulink.Parameter(0.0001952)
Lq = Simulink.Parameter(0.0001952)
Ls = Simulink.Parameter(0.0001952, StorageClass="Struct", StructName="PMSM_Para")
PLL_P = Simulink.Parameter(10, StorageClass="Struct", StructName="Obe_Para")
Psi_Sin = Simulink.Signal(StorageClass="Struct", StructName="Obe_data")
Psi_Cos = Simulink.Signal(StorageClass="Struct", StructName="Obe_data")
Ref_Iq = Simulink.Signal(StorageClass="Struct", StructName="Obe_data")
current_bandwidth = Simulink.Parameter(1500, StorageClass="Struct", StructName="PI_Para")
PLL_I = Simulink.Parameter(3000, StorageClass="Struct", StructName="Obe_Para")
Min_FLL_omega = Simulink.Parameter(10, StorageClass="Struct", StructName="SOSOIFOParam")
FLL_K = Simulink.Parameter(1.414, StorageClass="Struct", StructName="SOSOIFOParam")
Idq_limit = Simulink.Parameter(20)
IF_Initial = 40
b0 = Simulink.Parameter(10000, StorageClass="Struct", StructName="LADRC_Para")
tao = Simulink.Parameter(-30, StorageClass="Struct", StructName="SOSOIFOParam")
Swich_time = Simulink.Parameter(1.5, StorageClass="Struct", StructName="SOSOIFOParam")
CCR_Counter = 8000
ADRC_times = Simulink.Parameter(1, StorageClass="Struct", StructName="LADRC_Para")
omega_c = Simulink.Parameter(50, StorageClass="Struct", StructName="LADRC_Para")