% Simulink data dictionary NolinearObserver.sldd

Ts = 0.0001
PMSM_Pn = 5
Use_theta = Simulink.Signal(StorageClass="Struct", StructName="Obe_data")
Idq_limit = Simulink.Parameter(10)
Over_V = Simulink.Signal(StorageClass="Struct", StructName="ERROR_State")
STOP = Simulink.Signal(StorageClass="Struct", StructName="ERROR_State")
Low_V = Simulink.Signal(StorageClass="Struct", StructName="ERROR_State")
IF_Initial = Simulink.Parameter(30, StorageClass="Struct", StructName="SOSOIFOParam")
flux = Simulink.Parameter(0.0065, StorageClass="Struct", StructName="PMSM_Para")
PMSM_flux = 0.0065
PMSM_Rs = 0.03
PMSM_Ls = 8.5e-5
SPEED_KP = Simulink.Parameter(0.004, StorageClass="Struct", StructName="SPEED", DataType="single")
SPEED_KI = Simulink.Parameter(0.03, StorageClass="Struct", StructName="SPEED", DataType="single")
current_bandwidth = Simulink.Parameter(2216, StorageClass="Struct", StructName="PI_Para")
Gama = Simulink.Parameter(100000)
PLL_KP = Simulink.Parameter(500, StorageClass="Struct", StructName="PLL", DataType="single")
PLL_KI = Simulink.Parameter(20000, StorageClass="Struct", StructName="PLL", DataType="single")