% Simulink data dictionary nfo.sldd

ia = Simulink.Signal(StorageClass="ExportedGlobal", DataType="single")
ic = Simulink.Signal(StorageClass="ExportedGlobal", DataType="single")
ib = Simulink.Signal(StorageClass="ExportedGlobal", DataType="single")
ialpha = Simulink.Signal(StorageClass="ExportedGlobal", DataType="single")
ibeta = Simulink.Signal(StorageClass="ExportedGlobal", DataType="single")
id = Simulink.Signal(StorageClass="ExportedGlobal", DataType="single")
iq = Simulink.Signal(StorageClass="ExportedGlobal", DataType="single")
Sig = Simulink.Signal()
Udc = Simulink.Parameter(24, DataType="single")
Ts = Simulink.Parameter(0.0001, DataType="single")
smo_we = Simulink.Signal(StorageClass="ExportedGlobal", DataType="single")
Rs = Simulink.Parameter(0.035, DataType="single")
L = Simulink.Parameter(8.5e-5, DataType="single")
flux = Simulink.Parameter(0.0059, DataType="single")
Pn = Simulink.Parameter(5, DataType="single")
if_init = Simulink.Parameter(40)